# Grasshopper definition NOW_AI_test1.gh (Grasshopper 1.0.7)
# plug-ins: Human, Pufferfish, MeshEdit Components

# ---- group: SHP_USME BOUNDARY
crv = Curve(Tree({0;0;0}: [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], {1;0;0}: [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], {2;0;0}: [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], {3;0;0}: [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], {4;0;0}: [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], {5;0;0}: [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], {5;1;0}: [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], {5;2;0}: [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], {5;3;0}: [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], {6;0;0}: [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]))

# ----
previewlw = CustomPreviewLineweights(Geometry=crv, Shader=ColourSwatch(SwatchColor=RGB(0, 0, 0)), Thickness=Slider(1, range=1..5), Absolute=False)

# ---- group: EXISTING / SHP_RISK_EXISTING
crv_2 = Curve(Tree({0;0;0}: [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], {0;1;0}: [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], {0;2;0}: [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], {0;3;0}: [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], {0;4;0}: [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], {0;5;0}: [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]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))

# ---- group: EXISTING / SHP_VALS_METADATA
data = Data(Tree({0;0}: ["1", "2", "77017.59", "5102703"], {0;1}: ["1", "2", "77017.59", "5102703"], {0;2}: ["1", "2", "77017.59", "5102703"], {0;3}: ["1", "2", "77017.59", "5102703"], {0;4}: ["1", "2", "77017.59", "5102703"], {0;5}: ["1", "2", "77017.59", "5102703"]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))

# ---- group: SHP_RISK_1
crv_3 = Curve([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])

# ---- group: SHP_RISK_2
crv_4 = Curve([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])

# ---- group: SHP_RISK_3
crv_5 = Curve([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])

# ---- group: SHP_RISK_4
crv_6 = Curve([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])

# ---- group: SHP_RISK_5
crv_7 = Curve([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])

# ---- group: SHP_USME URB BDY
crv_8 = Curve(Tree({0;0;0}: [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], {1;0;0}: [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], {2;0;0}: [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], {3;0;0}: [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], {4;0;0}: [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], {5;0;0}: [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], {5;1;0}: [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], {5;2;0}: [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], {5;3;0}: [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], {6;0;0}: [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]))

# ----
entwine = Entwine(Branch00=crv_3, Branch01=crv_4, Branch02=crv_5, Branch03=crv_6, Branch04=crv_7, Branch05=crv_8, FlattenInputs=True)
bang = ExplodeTree(Data=entwine)  # -> Branch0, Branch1, Branch2, Branch3, Branch4, Branch5

# ---- group: EXISTING / USME URB BDY
crv_9 = Curve(crv)

# ---- group: RISK 3
# EXISTING -RISK
swatch = ColourSwatch(SwatchColor=RGB(74, 130, 118))
previewlw_2 = CustomPreviewLineweights(Geometry=bang.Branch0, Shader=swatch, Thickness=Slider(1, range=1..5), Absolute=False)

# ---- group: RISK 4
previewlw_3 = CustomPreviewLineweights(
    Geometry=bang.Branch1,
    Shader=ColourSwatch(SwatchColor=RGB(78, 64, 118)),
    Thickness=Slider(3, range=1..5),
    Absolute=False)

# ---- group: RISK 5
previewlw_4 = CustomPreviewLineweights(
    Geometry=bang.Branch2,
    Shader=ColourSwatch(SwatchColor=RGB(187, 0, 118)),
    Thickness=Slider(3, range=1..5),
    Absolute=False)

# ----
brec = BoundingRectangle(Geometry=flatten(entwine), Plane=PlaneXY(0, 0, 0), Axis=0, Slide=0, Union=True)  # -> Bounding, DimensionX, DimensionY

# ---- group: BOUNDING_RECTANGLE
srf = Surface(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)

# ---- group: TAG
offset = OffsetCurve(Curve=srf, Distance=Slider(638, range=0..10000), Corners=1)
explode = Explode(Curve=offset, Recursive=True)  # -> Segments, Vertices
midpt = CurveMiddle(Curve=explode.Segments)
pdecon = Deconstruct(Point=midpt)  # -> XComponent, YComponent, ZComponent
sort = SortList(Keys=pdecon.YComponent, ValuesA=explode.Segments)  # -> Keys, ValuesA
item = ListItem(List=sort.ValuesA, Index=0, Wrap=True)  # -> Item1, Item
dash = DashPattern(Curve=srf, Pattern=Slider(201, range=0..500))  # -> Dashes, Gaps
curvepoint = PointOnCurve(item.Item1, parameter=0.591)
tag = TextTag(Location=curvepoint, Text="EXISTING RISK MAP")
previewlw_5 = CustomPreviewLineweights(Geometry=dash.Dashes, Shader=ColourSwatch(SwatchColor=RGB(255, 255, 255)), Thickness="2", Absolute=False)

# ----
number_slider = Slider(100, range=0..200)
srf_2 = Surface(srf)
mesh_uv = MeshSurface(Surface=srf_2, UCount=number_slider, VCount=number_slider, Overhang=True, Equalize=False)
facen = FaceNormals(Mesh=mesh_uv)  # -> Centers, Normals
explode_2 = MeshExplode(Mesh=mesh_uv, Interpolate=False)
pt = Point(facen.Centers)

# ---- group: RH_IN:height
height = Slider(19, range=0..50)

# ---- group: RH_IN:usmeBdy
toggle = BooleanToggle(True)

# ---- group: LVL5
rgb = ColourRGB(
    Alpha=Slider(255, range=0..255),
    Red=Slider(0, range=0..255),
    Green=Slider(18, range=0..255),
    Blue=Slider(51, range=0..255))

# ---- group: SRF
mesh = Mesh(mesh_uv)

# ---- group: LVL4
rgb_2 = ColourRGB(
    Alpha=Slider(255, range=0..255),
    Red=Slider(51, range=0..255),
    Green=Slider(65, range=0..255),
    Blue=Slider(92, range=0..255))

# ---- group: LVL3
rgb_3 = ColourRGB(
    Alpha=Slider(255, range=0..255),
    Red=Slider(92, range=0..255),
    Green=Slider(103, range=0..255),
    Blue=Slider(125, range=0..255))

# ---- group: LVL2
rgb_4 = ColourRGB(
    Alpha=Slider(255, range=0..255),
    Red=Slider(151, range=0..255),
    Green=Slider(157, range=0..255),
    Blue=Slider(172, range=0..255))

# ---- group: LVL1
rgb_5 = ColourRGB(
    Alpha=Slider(0, range=0..255),
    Red=Slider(202, range=0..255),
    Green=Slider(240, range=0..255),
    Blue=Slider(248, range=0..255))

# ---- group: LVL2
crv_10 = Curve(bang.Branch1)

# ---- group: LVL3
crv_11 = Curve(bang.Branch2)

# ---- group: LVL4
crv_12 = Curve(bang.Branch3)

# ---- group: LVL5
crv_13 = Curve(bang.Branch4)

# ----
pt_2 = Point(pt)
incurves = PointInCurves(Point=pt_2, Curves=crv_12)  # -> Relationship, Index, Point
smaller = SmallerThan(FirstNumber="0", SecondNumber=incurves.Relationship)  # -> SmallerThan, OrEqualTo
cull = CullPattern(List=explode_2, CullPattern=smaller.SmallerThan)
cull_2 = CullPattern(List=pt_2, CullPattern=smaller.SmallerThan)
mcol = MeshColours(Mesh=cull, Colours=rgb_2)
dots = DotDisplay(Point=cull_2, Colour=RGB(255, 0, 0), Size=Slider(15, range=0..20))

pt_3 = Point(pt)
incurves_2 = PointInCurves(Point=pt_3, Curves=crv_10)  # -> Relationship, Index, Point
smaller_2 = SmallerThan(FirstNumber="0", SecondNumber=incurves_2.Relationship)  # -> SmallerThan, OrEqualTo
cull_3 = CullPattern(List=pt_3, CullPattern=smaller_2.SmallerThan)
cull_4 = CullPattern(List=explode_2, CullPattern=smaller_2.SmallerThan)
dots_2 = DotDisplay(Point=cull_3, Colour=RGB(255, 0, 0), Size=Slider(15, range=0..20))

pt_4 = Point(pt)
incurves_3 = PointInCurves(Point=pt_4, Curves=crv_13)  # -> Relationship, Index, Point
smaller_3 = SmallerThan(FirstNumber="0", SecondNumber=incurves_3.Relationship)  # -> SmallerThan, OrEqualTo
cull_5 = CullPattern(List=pt_4, CullPattern=smaller_3.SmallerThan)
cull_6 = CullPattern(List=explode_2, CullPattern=smaller_3.SmallerThan)
dots_3 = DotDisplay(Point=cull_5, Colour=RGB(255, 0, 0), Size=Slider(15, range=0..20))

# ----
# EXSITING RISK
swatch_2 = ColourSwatch(SwatchColor=RGB(140, 116, 181))

pt_5 = Point(pt)
incurves_4 = PointInCurves(Point=pt_5, Curves=crv_11)  # -> Relationship, Index, Point
smaller_4 = SmallerThan(FirstNumber="0", SecondNumber=incurves_4.Relationship)  # -> SmallerThan, OrEqualTo
cull_7 = CullPattern(List=pt_5, CullPattern=smaller_4.SmallerThan)
cull_8 = CullPattern(List=explode_2, CullPattern=smaller_4.SmallerThan)
dots_4 = DotDisplay(Point=cull_7, Colour=swatch_2, Size=Slider(15, range=0..20))

mcol_2 = MeshColours(Mesh=cull_6, Colours=rgb)
mcol_3 = MeshColours(Mesh=cull_4, Colours=rgb_4)
mcol_4 = MeshColours(Mesh=cull_8, Colours=rgb_3)

# ---- group: RH_IN:E_risk5
toggle_2 = BooleanToggle(True)

# ---- group: RH_IN:E_risk3
toggle_3 = BooleanToggle(True)

# ---- group: RH_IN:E_risk4
toggle_4 = BooleanToggle(True)

# ---- group: RH_IN:E_risk2
toggle_5 = BooleanToggle(True)

# ---- group: RH_IN:E_risk1
toggle_6 = BooleanToggle(True)

# ----
filter = StreamFilter(Gate=toggle_5, Stream1=mcol_3)
filter_2 = StreamFilter(Gate=toggle_3, Stream1=mcol_4)
filter_3 = StreamFilter(Gate=toggle_4, Stream1=mcol)
filter_4 = StreamFilter(Gate=toggle_2, Stream1=mcol_2)

# ---- group: RH_OUT:E_RISK2
mesh_2 = Mesh(filter)

# ---- group: RH_OUT:E_RISK3
mesh_3 = Mesh(filter_2)

# ---- group: RH_OUT:E_RISK4
mesh_4 = Mesh(filter_3)

# ---- group: RH_OUT:E_RISK5
mesh_5 = Mesh(filter_4)

# ---- group: EXISTING
# USME-  INTERVENTION
panel = Panel("1")
item_2 = ListItem(List=data, Index=panel, Wrap=True)  # -> flatten(Item)
panel_2 = Panel(item_2)
X = UnitX(Factor=Slider(7000, range=0..100000))

# ---- group: EXISTING / CRVS HAZ 3
equals = Equality(FirstNumber=item_2, SecondNumber="3")  # -> Equality, Inequality
cull_9 = CullPattern(List=flatten(crv_2), CullPattern=equals.Equality)
join = JoinCurves(Curves=cull_9, Preserve=False)

# ---- group: EXISTING / CRVS_HAZ4
equals_2 = Equality(FirstNumber=item_2, SecondNumber="4")  # -> Equality, Inequality
cull_10 = CullPattern(List=flatten(crv_2), CullPattern=equals_2.Equality)
join_2 = JoinCurves(Curves=cull_10, Preserve=False)

# ---- group: EXISTING / CRVS_HAZ5
equals_3 = Equality(FirstNumber=item_2, SecondNumber="5")  # -> Equality, Inequality
cull_11 = CullPattern(List=flatten(crv_2), CullPattern=equals_3.Equality)
join_3 = JoinCurves(Curves=cull_11, Preserve=False)

# ---- group: EXISTING (continued)
crv_14 = Curve(join_3)
crv_15 = Curve(join)
crv_16 = Curve(join_2)
entwine_2 = Entwine(Branch00=crv_15, Branch01=crv_16, Branch02=crv_14, Branch03=crv_9, FlattenInputs=True)
move = Move(Geometry=entwine_2, Motion=X)  # -> Geometry, Transform
bang_2 = ExplodeTree(Data=move.Geometry)  # -> Branch0, Branch1, Branch2, Branch3

# ---- group: USME URBAN BOUNDARY
crv_17 = Curve(bang_2.Branch3)

# ---- group: RISK 3
# EXISTING - WEIGHTED SUM HAZARD
swatch_3 = ColourSwatch(SwatchColor=RGB(255, 179, 118))
previewlw_6 = CustomPreviewLineweights(Geometry=bang_2.Branch0, Shader=swatch_3, Thickness=Slider(1, range=1..5), Absolute=False)

# ---- group: RISK 4
previewlw_7 = CustomPreviewLineweights(
    Geometry=bang_2.Branch1,
    Shader=ColourSwatch(SwatchColor=RGB(255, 119, 118)),
    Thickness=Slider(3, range=1..5),
    Absolute=False)

# ---- group: RISK 5
previewlw_8 = CustomPreviewLineweights(
    Geometry=bang_2.Branch2,
    Shader=ColourSwatch(SwatchColor=RGB(245, 10, 118)),
    Thickness=Slider(3, range=1..5),
    Absolute=False)

# ---- group: USME URBAN BOUNDARY
# USME URB BOUNDARY
crv_18 = Curve(bang.Branch5)
merge = Merge(Data1=crv_17, Data2=crv_18)
Z = UnitZ(Factor=height)
move_2 = Move(Geometry=merge, Motion=Z)  # -> Geometry, Transform
join_4 = JoinCurves(Curves=move_2.Geometry, Preserve=False)

# ----
filter_5 = StreamFilter(Gate=toggle, Stream1=crv_18)
panel_3 = Panel(filter_5)

# ---- group: RH_OUT:usme
crv_19 = Curve(filter_5)

# ---- group: USME URBAN BOUNDARY (continued)
previewlw_9 = CustomPreviewLineweights(Geometry=crv_19, Shader=ColourSwatch(SwatchColor=RGB(20, 0, 124)), Thickness=Slider(2, range=1..5), Absolute=False)

# ---- group: USME URB BDY
crv_20 = Curve(crv_18)

# ---- group: RISK LEVEL 1
facen_2 = FaceNormals(Mesh=mesh)  # -> Centers, Normals
explode_3 = MeshExplode(Mesh=mesh, Interpolate=False)
incurves_5 = PointInCurves(Point=facen_2.Centers, Curves=crv_4)  # -> Relationship, Index, Point
smaller_5 = SmallerThan(FirstNumber="0", SecondNumber=incurves_5.Relationship)  # -> SmallerThan, OrEqualTo
larger = LargerThan(FirstNumber="0", SecondNumber=incurves_5.Relationship)  # -> LargerThan, OrEqualTo
cull_12 = CullPattern(List=explode_3, CullPattern=larger.OrEqualTo)
mesh_6 = Mesh(cull_12)
facen_3 = FaceNormals(Mesh=mesh_6)  # -> flatten(Centers), Normals
incurves_6 = PointInCurves(Point=facen_3.Centers, Curves=crv_20)  # -> Relationship, Index, Point
smaller_6 = SmallerThan(FirstNumber="0", SecondNumber=incurves_6.Relationship)  # -> SmallerThan, OrEqualTo
cull_13 = CullPattern(List=mesh_6, CullPattern=smaller_6.SmallerThan)

# ----
mjoin = MeshJoin(Meshes=cull_13)
mesh_7 = Mesh(cull_13)
facen_4 = FaceNormals(Mesh=mesh_7)  # -> Centers, Normals
mcol_5 = MeshColours(Mesh=mjoin, Colours=rgb_5)

filter_6 = StreamFilter(Gate=toggle_6, Stream1=mcol_5)

# ---- group: RH_OUT:E_RISK1
mesh_8 = Mesh(filter_6)
