# Grasshopper definition SPHERES.gh (Grasshopper 1.0.7)

# ---- group: RH_IN:NUMBER
number_slider = Slider(10, range=2..10)

# ---- group: RH_IN:RADIUS
number_slider_2 = Slider(30, range=10..30)

# ---- group: RH_IN:SEED
number_slider_3 = Slider(2, range=0..3)

# ----
B = Base(PlaneXY(0, 0, 0))
msphere = MeshSphere(Base=B, Radius=number_slider_2, UCount=10, VCount=20)
popgeo = PopulateGeometry(Geometry=msphere, Count=number_slider, Seed=number_slider_3)
intcrv = Interpolate(Vertices=popgeo, Degree=3, Periodic=True, KnotStyle=1)  # -> Curve, Length, Domain
crv = Curve(intcrv.Curve)
bbox = BoundingBox(Content=crv, Plane=PlaneXY(0, 0, 0))  # -> Box, Box_2
number_slider_4 = Slider(1.2, range=0..10)
volume = Volume(Geometry=bbox.Box)  # -> Volume, Centroid
scale_nu = ScaleNU(Geometry=bbox.Box, Plane=volume.Centroid, ScaleX=number_slider_4, ScaleY=number_slider_4, ScaleZ=number_slider_4)  # -> Geometry, Transform
geo = Geometry(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)
pt = Point([Point(36, 52.66666667, 1.333333333), Point(34.84529946, 54.66666667, 1.333333333), Point(37.15470054, 54.66666667, 1.333333333), Point(36, 54, 0)])
crv_2 = Curve([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])
fieldpts = Wasp_FieldPoints(BOU=scale_nu.Geometry, RES=Slider(10, range=0..10))  # -> E_FIELD, PTS; inputs BOU: list of Mesh; plug-in component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
mesh = MeshBrep(
    Brep=geo,
    Settings={GridMaxCount=0, GridMinCount=16, JaggedSeams=False, MaxEdgeLength=0, MinEdgeLength=0.0001, MinTolerance=0, Refine=True, RefineAngle=0, RelativeTolerance=0.65, SimplePlanes=True, Tolerance=0})
mesh_2 = Mesh(mesh)
pull = PullPoint(Point=fieldpts.PTS, Geometry=crv, ClosestOnly=True)  # -> ClosestPoint, Distance
conndir = Wasp_ConnectionFromDirection(GEO=mesh_2, CEN=pt, UP=crv_2)  # -> CONN, PLN_OUT; inputs CEN: list of Point3d, UP: list of Curve, T: list; plug-in component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
part = Wasp_BasicPart(NAME="TEST", GEO=mesh_2, CONN=flatten(conndir.CONN))  # -> PART; inputs GEO: Mesh, CONN: list, COLL: Mesh, ATTR: list; plug-in component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
bnd = Bounds(Numbers=pull.Distance)
remap = RemapNumbers(Value=pull.Distance, Source=bnd, Target="1 To 0")  # -> Mapped, Clipped
graph = GraphMapper(
    remap.Mapped,
    x0=0,
    x1=1,
    y0=0,
    y1=1,
    container_name="Bezier",
    cpx=[0, 0.56805861, 0.9374186397, 1],
    cpy=[0, 0.02397572994, 0.569886148, 1])
rulegen = Wasp_RulesGenerator(PART=part)  # -> R; inputs PART: list, SELF_P: Boolean, SELF_C: Boolean, TYP: Boolean, GR: list; plug-in component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
field = Wasp_Field(NAME="Field Test", E_FIELD=fieldpts.E_FIELD, VAL=graph)  # -> FIELD; inputs VAL: list; plug-in component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

# ---- group: RH_IN:parts
number_slider_5 = Slider(1, range=0..500)

# ----
fieldaggregation = Wasp_FieldDrivenAggregation(PART=flatten(part), N=number_slider_5, RULES=rulegen, FIELD=field, RESET=Button())  # -> AGGR, PART_OUT; inputs PART: list, PREV: list, N: Int32, RULES: list, FIELD: list, MODE: Int32, GC: list, RESET: Boolean; plug-in component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
partgeo = Wasp_GetPartGeometry(PART=fieldaggregation.PART_OUT)  # -> GEO; plug-in component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
mjoin = MeshJoin(Meshes=partgeo)

# ---- group: RH_OUT:mesh
mesh_3 = Mesh(mjoin)
